% Simulink data dictionary PhysicalInterfaces.sldd

IngredientPallet = Simulink.Bus()
  palletId: double
  mass_kg: double
  temp_C: double

PreparedBatch = Simulink.Bus()
  batchId: double
  recipeId: double
  mass_kg: double

SoupStream = Simulink.Bus()
  batchId: double
  volume_L: double
  temp_C: double
  contamination_ppm: double

SealedContainerBatch = Simulink.Bus()
  batchId: double
  count: double
  sealRating_days: double

ShippingManifestMsg = Simulink.Bus()
  destinationId: double
  batchId: double
  count: double
  mass_kg: double

StockData = Simulink.Bus()
  itemId: double
  qty_units: double
  error_pct: double

OrderPacket = Simulink.Bus()
  orderId: double
  recipeId: double
  qty_bowls: double
  destinationId: double

ControlBus = Simulink.Bus()
  cmdType: double
  targetId: double
  setpoint: double

StatusBus = Simulink.Bus()
  unitId: double
  opState: double
  faultCode: double

GravityData = Simulink.Bus()
  gravity_g: double
  compensation_pct: double