% Simulink data dictionary BehParamsCommon.sldd
% references BehaviorInterfaces.sldd

Bowl_kg = 0.55
Soup_cp_JpkgK = 3900
FillTemp_C = 12
Ambient_C = 25
VatLoss_WpK = 15
Gravity_g = 1
SimmerTemp_C = 94
QC_DetectSensitivity = 0.995
QC_ContamIncidence = 0
Recipe_Count = 8
Recipe_Block_s = 1800
Recipe_Flush_s = 0
Rocket_Load_bowls = 60
Rocket_Handling_s = 120