% Simulink data dictionary BehParamsHyperCook.sldd
% references BehParamsCommon.sldd

HC_PrepRate_bph = 160
HC_NumPrep = 2
HC_CookRate_bph = 90
HC_CookPowerFull_kW = 50
HC_CookPowerIdle_kW = 8
HC_CookTau_s = 180
HC_QCRate_bph = 400
HC_QCReject = 0.02
HC_QCCalibPeriod_s = 3600
HC_QCCalibTime_s = 60
HC_PackRate_bph = 340
Transport_Rate_bph = 400
Transport_Latency_s = 30
HC_StorageInit_bowls = 1500
HC_Resupply_bph = 330
HC_NumLines = 4
HC_StaticPower_kW = 298
HC_StorageCap_bowls = 22300