% Simulink data dictionary BehParamsIronLadle.sldd
% references BehParamsCommon.sldd

IL_PrepRate_bph = 80
IL_BatchSize_bowls = 40
IL_HeaterPower_kW = 32
IL_VatThermalMass_JpK = 96000
IL_FillRate_bps = 0.4
IL_SimmerTime_s = 1182
IL_DrainTime_s = 150
IL_CleanTime_s = 120
IL_QCRate_bph = 90
IL_QCReject = 0.02
IL_QCCalibPeriod_s = 5400
IL_QCCalibTime_s = 90
IL_PackRate_bph = 85
Transport_Rate_bph = 300
Transport_Latency_s = 60
IL_StorageCap_bowls = 1200
IL_StorageInit_bowls = 900
IL_Resupply_bph = 245
IL_NumLines = 3
IL_StaticPower_kW = 267