% Simulink data dictionary BehParamsLeanBroth.sldd
% references BehParamsCommon.sldd

LB_PrepRate_bph = 210
LB_BatchSize_bowls = 55
LB_HeaterPower_kW = 45
LB_VatThermalMass_JpK = 130000
LB_FillRate_bps = 0.5
LB_SimmerTime_s = 1130
LB_DrainTime_s = 200
LB_CleanTime_s = 120
LB_QCRate_bph = 230
LB_QCReject = 0.03
LB_QCCalibPeriod_s = 7200
LB_QCCalibTime_s = 300
LB_PackRate_bph = 220
Transport_Rate_bph = 250
Transport_Latency_s = 120
LB_StorageInit_bowls = 600
LB_Resupply_bph = 215
LB_NumLines = 2
LB_StaticPower_kW = 149
LB_StorageCap_bowls = 14300