test file "GalacticSoupSystemTests"

suite "Nominal"

  case "HyperCook nominal" [simulation]
    model PhysicalHyperCook, stop time 14400
    custom criteria:
      yout = test.sltest_simout.get('yout');
      flow = []; tele = [];
      for i = 1:yout.numElements
          v = yout{i}.Values;
          if isstruct(v) && isfield(v,'flow_bps'), flow = v.flow_bps; end
          if isstruct(v) && isfield(v,'totalPower_kW'), tele = v; end
      end
      sel = flow.Time > 7200;
      bph = trapz(flow.Time(sel), flow.Data(sel))/(flow.Time(end)-7200)*3600;
      test.verifyGreaterThanOrEqual(bph, 200, 'SR-GS-002 floor');
      test.verifyEqual(bph, 308.4, 'AbsTol', 3, 'regression band');
      test.verifyEqual(double(tele.plantMode.Data(end)), 1, 'Nominal mode');

  case "LeanBroth nominal - regression baseline" [simulation]
    model PhysicalLeanBroth, stop time 14400
    custom criteria:
      yout = test.sltest_simout.get('yout');
      flow = []; tele = [];
      for i = 1:yout.numElements
          v = yout{i}.Values;
          if isstruct(v) && isfield(v,'flow_bps'), flow = v.flow_bps; end
          if isstruct(v) && isfield(v,'totalPower_kW'), tele = v; end
      end
      sel = flow.Time > 7200;
      bph = trapz(flow.Time(sel), flow.Data(sel))/(flow.Time(end)-7200)*3600;
      test.verifyEqual(bph, 196.8, 'AbsTol', 3, 'regression band');
      test.verifyEqual(double(tele.plantMode.Data(end)), 1, 'Nominal mode');

  case "EverSimmer nominal" [simulation]
    model PhysicalEverSimmer, stop time 14400
    custom criteria:
      yout = test.sltest_simout.get('yout');
      flow = []; tele = [];
      for i = 1:yout.numElements
          v = yout{i}.Values;
          if isstruct(v) && isfield(v,'flow_bps'), flow = v.flow_bps; end
          if isstruct(v) && isfield(v,'totalPower_kW'), tele = v; end
      end
      sel = flow.Time > 7200;
      bph = trapz(flow.Time(sel), flow.Data(sel))/(flow.Time(end)-7200)*3600;
      test.verifyGreaterThanOrEqual(bph, 200, 'SR-GS-002 floor');
      test.verifyEqual(bph, 231.9, 'AbsTol', 3, 'regression band');
      test.verifyEqual(double(tele.plantMode.Data(end)), 1, 'Nominal mode');

suite "WorstFault"

  case "HyperCook worst fault - regression baseline" [simulation]
    model PhysicalHyperCook, stop time 21600
    parameter set "worstFault": Fault_T_QC = 7200
    custom criteria:
      yout = test.sltest_simout.get('yout');
      flow = []; tele = [];
      for i = 1:yout.numElements
          v = yout{i}.Values;
          if isstruct(v) && isfield(v,'flow_bps'), flow = v.flow_bps; end
          if isstruct(v) && isfield(v,'totalPower_kW'), tele = v; end
      end
      pre  = flow.Time > 3600  & flow.Time < 7200;
      post = flow.Time > 14400;
      preR  = trapz(flow.Time(pre),  flow.Data(pre))/3600;
      postR = trapz(flow.Time(post), flow.Data(post))/7200;
      retention = postR/preR;
      test.verifyEqual(retention, 0, 'AbsTol', 0.02, 'worst-fault retention');

  case "LeanBroth worst fault - regression baseline" [simulation]
    model PhysicalLeanBroth, stop time 21600
    parameter set "worstFault": Fault_T_Prep = 7200
    custom criteria: same code as in custom criteria of case "HyperCook worst fault - regression baseline"

  case "EverSimmer worst fault" [simulation]
    model PhysicalEverSimmer, stop time 21600
    parameter set "worstFault": Fault_T_Cell1 = 7200
    custom criteria:
      yout = test.sltest_simout.get('yout');
      flow = []; tele = [];
      for i = 1:yout.numElements
          v = yout{i}.Values;
          if isstruct(v) && isfield(v,'flow_bps'), flow = v.flow_bps; end
          if isstruct(v) && isfield(v,'totalPower_kW'), tele = v; end
      end
      pre  = flow.Time > 3600  & flow.Time < 7200;
      post = flow.Time > 14400;
      preR  = trapz(flow.Time(pre),  flow.Data(pre))/3600;
      postR = trapz(flow.Time(post), flow.Data(post))/7200;
      retention = postR/preR;
      test.verifyEqual(double(tele.plantMode.Data(end)), 2, 'Degraded mode');
      test.verifyEqual(retention, 0.672, 'AbsTol', 0.02, 'worst-fault retention');